# Grasshopper definition cy.gh (Grasshopper 0.9.56)

radgrid = Radial(Plane=PlaneXY(0, 0, 0), Size=0.9, ExtentR=13, ExtentP=40)  # -> Cells, Points
number_slider = Slider(11, range=0..11)
number_slider_2 = Slider(0, range=0..10)
flip = FlipMatrix(Data=radgrid.Cells)
item = ListItem(List=flip, Index=0, Wrap=True)
wires = BrepWireframe(Brep=flatten(item), Density=-1)
Z = UnitZ(Factor=Slider(0.8, range=0..2))
subtraction = Subtraction(A=number_slider, B=1)
series = Series(Start=0, Step=1, Count=number_slider)
item_2 = ListItem(List=wires, Index=2, Wrap=True)
join = JoinCurves(Curves=flatten(item_2), Preserve=False)
multiplication = Multiplication(A=Z, B=series)
smoothpline = SmoothPolyline(Polyline=join, Strength=1, Times=2)
extr = Extrude(Base=smoothpline, Direction=Z)
int = Integer([0, 34, 52, 73, 97, 122, 147, 173, 200, 228, 255])
int_2 = Integer([0, 34, 52, 73, 97, 121, 147, 173, 200, 228, 255])
int_3 = Integer([0, 34, 52, 73, 97, 122, 147, 173, 200, 228, 255])
move = Move(Geometry=extr, Motion=multiplication)  # -> Geometry, Transform
rgb = ColourRGB(Alpha=255, Red=int_3, Green=int, Blue=int_2)
item_3 = ListItem(List=move.Geometry, Index=[number_slider_2, subtraction], Wrap=True)
cap = CapHoles(Brep=item_3)
replace = ReplaceItems(List=move.Geometry, Item=cap, Indices=[number_slider_2, subtraction], Wrap=False)
move_2 = Move(Geometry=replace, Motion=expr("-T", Z))  # -> Geometry, Transform
preview = CustomPreview(Geometry=move_2.Geometry, Shader=rgb)
cluster = Bake出GH里的颜色(blnbake=Toggle(False), obj=move_2.Geometry, color=rgb)  # -> out, A, type

# ==== cluster Bake出GH里的颜色
blnbake = ClusterInput()
layer = ClusterInput()
obj = ClusterInput()
color = ClusterInput()
vb_bakebrepcolor = VBScript(blnBake=blnbake, obj=obj, color=color, layer=layer)  # -> out, A, type; inputs obj: Brep, color: Color
# ---------- vb_bakebrepcolor: VB ----------
    If blnBake Then

      Dim att As New Rhino.DocObjects.ObjectAttributes()
      Dim t As String
      att.ColorSource = Rhino.DocObjects.ObjectColorSource.ColorFromObject
      att.ObjectColor = color

      If String.IsNullOrEmpty(layer) Then
        att.LayerIndex = doc.Layers.CurrentLayerIndex

      Else

        Dim layer_index As Integer = doc.Layers.Find(layer, True)
        If layer_index >= 0 Then
          att.LayerIndex = layer_index

        Else
          layer_index = doc.Layers.Add(layer, System.Drawing.Color.Black)
          att.LayerIndex = layer_index

        End If

      End If

      'If TypeOf obj Is Brep Then
      Dim mObj As Guid
      mObj = doc.Objects.AddBRep(obj, att)
      t = "BRep"
      type = t
      'End If

    End If
# ---------- end vb_bakebrepcolor ----------
type = ClusterOutput(vb_bakebrepcolor.type)
out = ClusterOutput(vb_bakebrepcolor.out)
A = ClusterOutput(vb_bakebrepcolor.A)
