# Grasshopper definition model.gh (Grasshopper 0.9.56)

_5 = _5()  # -> txt_2, int_6, int_4, int_5
_4 = _4()  # -> txt_2, int_6, int_4, int_5
_3 = _3()  # -> txt_2, int_6, int_4, int_5
_1 = _1()  # -> txt_2, int_5, int_4, int_6
_2 = _2()  # -> txt_2, int_6, int_4, int_5
_8 = _8()  # -> txt_2, int_6, int_4, int_5
_9 = _9()  # -> txt_2, int_5, int_6, int_4
_6 = _6()  # -> txt_2, int_6, int_4, int_5
_7 = _7()  # -> txt_2, int_6, int_4, int_5
panel = Panel(_9.txt_2)
radgrid = Radial(Plane=PlaneXY(0, 0, 0), Size=0.9, ExtentR=13, ExtentP=40)  # -> Cells, Points
rgb = ColourRGB(Alpha=255, Red=_9.int_5, Green=_9.int_6, Blue=_9.int_4)  # -> simplify(Colour)
cset = CreateSet(List=panel)  # -> graft(Set), Map
panel_2 = Panel(radgrid.Cells)
rev = ReverseList(List=radgrid.Cells)
mindex = MemberIndex(Set=panel, Member=flatten(cset.Set))  # -> Index, Count
lng = ListLength(List=flatten(cset.Set))
Z = UnitZ(Factor=Slider(0.8, range=0..2))
series = Series(Start=0, Step=1, Count=lng)
lng_2 = ListLength(List=mindex.Index)
item = ListItem(List=rev, Index=series, Wrap=True)
dom = ConstructDomain(DomainStart=1, DomainEnd=lng_2)
flip = FlipMatrix(Data=item)
simplify = SimplifyTree(Tree=flip, Front=False)
simplify_2 = SimplifyTree(Tree=dom, Front=False)
subset = SubList(List=simplify, Domain=simplify_2, Wrap=True)  # -> List, Index
extr = Extrude(Base=subset.List, Direction=Z)
cap = CapHoles(Brep=extr)
item_2 = ListItem(List=simplify(flatten(extr)), Index=Slider(16, range=0..31), Wrap=True)
cluster = Bake出GH里的颜色(blnbake=Toggle(False), obj=flatten(cap), color=rgb)  # -> out, A, type
preview = CustomPreview(Geometry=flatten(cap), Shader=rgb)
number_slider = Slider(48, range=0..51)
item_3 = ListItem(Index=Slider(48, range=0..51), Wrap=True)

# ==== cluster Bake出GH里的颜色
blnbake = ClusterInput()
layer = ClusterInput()
obj = ClusterInput()
color = ClusterInput()
vb_bakebrepcolor = VBScript(blnBake=blnbake, obj=obj, color=color, layer=layer)  # -> out, A, type; inputs obj: Brep, color: Color
# ---------- vb_bakebrepcolor: VB ----------
    If blnBake Then

      Dim att As New Rhino.DocObjects.ObjectAttributes()
      Dim t As String
      att.ColorSource = Rhino.DocObjects.ObjectColorSource.ColorFromObject
      att.ObjectColor = color

      If String.IsNullOrEmpty(layer) Then
        att.LayerIndex = doc.Layers.CurrentLayerIndex

      Else

        Dim layer_index As Integer = doc.Layers.Find(layer, True)
        If layer_index >= 0 Then
          att.LayerIndex = layer_index

        Else
          layer_index = doc.Layers.Add(layer, System.Drawing.Color.Black)
          att.LayerIndex = layer_index

        End If

      End If

      'If TypeOf obj Is Brep Then
      Dim mObj As Guid
      mObj = doc.Objects.AddBRep(obj, att)
      t = "BRep"
      type = t
      'End If

    End If
# ---------- end vb_bakebrepcolor ----------
type = ClusterOutput(vb_bakebrepcolor.type)
out = ClusterOutput(vb_bakebrepcolor.out)
A = ClusterOutput(vb_bakebrepcolor.A)

# ==== cluster _1
int = Integer([28, 22, 14, 0, 0, 0, 28, 22, 12, 0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])
txt = Text([".00R", ".00R", ".00R", ".00R", ".00R", ".00R", "2.50R", "2.50R", "2.50R", "2.50R"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])
int_2 = Integer([47, 55, 62, 69, 75, 82, 48, 56, 63, 71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])
int_3 = Integer([37, 39, 41, 44, 47, 51, 35, 36, 37, 39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])
int_4 = ClusterOutput(int)
txt_2 = ClusterOutput(txt)
int_5 = ClusterOutput(int_2)
int_6 = ClusterOutput(int_3)

# ==== cluster _2
txt = Text([".00R", ".00R", ".00R", ".00R", ".00R", ".00R", ".00R", "2.50R", "2.50R", "2.50R"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])
int = Integer([47, 42, 36, 25, 0, 0, 0, 47, 42, 35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])
int_2 = Integer([53, 54, 55, 56, 58, 60, 63, 51, 50, 49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])
int_3 = Integer([66, 76, 85, 94, 103, 112, 121, 67, 77, 86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])
txt_2 = ClusterOutput(txt)
int_4 = ClusterOutput(int)
int_5 = ClusterOutput(int_2)
int_6 = ClusterOutput(int_3)

# ==== cluster _3
int = Integer([68, 62, 55, 46, 33, 0, 0, 0, 68, 62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])
int_2 = Integer([71, 70, 69, 68, 68, 68, 68, 68, 69, 66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])
int_3 = Integer([90, 103, 114, 125, 136, 146, 155, 165, 91, 104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])
txt = Text([".00R", ".00R", ".00R", ".00R", ".00R", ".00R", ".00R", ".00R", "2.50R", "2.50R"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])
int_4 = ClusterOutput(int)
int_5 = ClusterOutput(int_2)
int_6 = ClusterOutput(int_3)
txt_2 = ClusterOutput(txt)

# ==== cluster _4
int = Integer([92, 86, 80, 72, 64, 52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])
int_2 = Integer([94, 92, 90, 89, 88, 87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])
int_3 = Integer([113, 127, 139, 151, 162, 173, 183, 193, 114, 128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])
txt = Text([".00R", ".00R", ".00R", ".00R", ".00R", ".00R", ".00R", ".00R", "2.50R", "2.50R"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])
int_4 = ClusterOutput(int)
int_5 = ClusterOutput(int_2)
int_6 = ClusterOutput(int_3)
txt_2 = ClusterOutput(txt)

# ==== cluster _5
int = Integer([117, 111, 105, 98, 90, 80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])
int_2 = Integer([119, 116, 113, 111, 109, 108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])
int_3 = Integer([136, 152, 166, 179, 191, 204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])
txt = Text([".00R", ".00R", ".00R", ".00R", ".00R", ".00R", ".00R", ".00R", ".00R", "2.50R"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])
int_4 = ClusterOutput(int)
int_5 = ClusterOutput(int_2)
int_6 = ClusterOutput(int_3)
txt_2 = ClusterOutput(txt)

# ==== cluster _6
int = Integer([143, 137, 131, 125, 117, 109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])
int_2 = Integer([144, 141, 138, 136, 133, 131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])
int_3 = Integer([162, 177, 193, 205, 219, 232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])
txt = Text([".00R", ".00R", ".00R", ".00R", ".00R", ".00R", ".00R", ".00R", "2.50R", "2.50R"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])
int_4 = ClusterOutput(int)
int_5 = ClusterOutput(int_2)
int_6 = ClusterOutput(int_3)
txt_2 = ClusterOutput(txt)

# ==== cluster _7
int = Integer([169, 164, 157, 151, 143, 134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])
int_2 = Integer([170, 167, 164, 160, 157, 154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])
int_3 = Integer([188, 204, 220, 235, 249, 255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])
txt = Text([".00R", ".00R", ".00R", ".00R", ".00R", ".00R", ".00R", ".00R", "2.50R", "2.50R"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])
int_4 = ClusterOutput(int)
int_5 = ClusterOutput(int_2)
int_6 = ClusterOutput(int_3)
txt_2 = ClusterOutput(txt)

# ==== cluster _8
int = Integer([197, 190, 184, 176, 169, 157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])
int_2 = Integer([198, 193, 190, 186, 182, 178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])
int_3 = Integer([213, 232, 249, 255, 255, 255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])
txt = Text([".00R", ".00R", ".00R", ".00R", ".00R", ".00R", "2.50R", "2.50R", "2.50R", "2.50R"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])
int_4 = ClusterOutput(int)
int_5 = ClusterOutput(int_2)
int_6 = ClusterOutput(int_3)
txt_2 = ClusterOutput(txt)

# ==== cluster _9
int = Integer([225, 220, 216, 224, 216, 209, 222, 211, 201, 220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])
int_2 = Integer([241, 255, 255, 241, 255, 255, 242, 255, 255, 243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])
int_3 = Integer([225, 218, 210, 224, 217, 210, 224, 217, 210, 224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])
txt = Text([".00R", ".00R", ".00R", "2.50R", "2.50R", "2.50R", "5.00R", "5.00R", "5.00R", "7.50R"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])
int_4 = ClusterOutput(int)
int_5 = ClusterOutput(int_2)
int_6 = ClusterOutput(int_3)
txt_2 = ClusterOutput(txt)
